# Dynamo graph export_levels.dyn (Dynamo 3.3.0.6316)

categories = Categories("OST_Levels")
all_elements_of_category = ElementsOfCategory(Category=categories)
name = Element.Name(element=all_elements_of_category)
elevation = Level.Elevation(level=all_elements_of_category)
id = Element.Id(element=all_elements_of_category)
python_script = Python(IN[0]=name, IN[1]=elevation, IN[2]=id)  # CPython3
# ---------- python_script.python (29 lines) ----------
import json
import os

names = IN[0]
elevs = IN[1]
ids   = IN[2]

if not isinstance(names, list):
    names = [names]

if not isinstance(elevs, list):
    elevs = [elevs]

if not isinstance(ids, list):
    ids = [ids]
    
output = []

for n, e, i in zip(names, elevs, ids):
    output.append({
        "name": n,
        "elevation": e,
        "id": i
    })
file_path = r"C:\Users\yhuang\Downloads\revit_automation_server\export_levels.json"
with open(file_path, 'w') as f:
    json.dump(output, f, indent=4)
# Output a list of dictionaries directly (NOT a JSON string!)
OUT = output
# ----------------------------------------
